# Grasshopper definition facade_panelization.gh (Grasshopper 1.0.8)
# plug-ins: Heteroptera, MeshEdit Components, Pufferfish, Human, LegoPod, PTComponentLibrary, Parakeet, Weaverbird, UiPlus, eleFront, Wombat, Telepathy

# ---- group: Start
rh_sel_btn = UiRhinoSelectButton(Label="Select Massing", Filter=0)
graphics = UiSetGraphics(
    Element=rh_sel_btn,
    PrimaryColor=ColourSwatch(SwatchColor=RGB(79, 79, 79)),
    AccentColor=ColourSwatch(SwatchColor=RGB(255, 255, 255)),
    StrokeColor=ColourSwatch(SwatchColor=RGB(71, 71, 71)))
font = UiSetFont(Element=rh_sel_btn, Size=Slider(12, range=0..100))
merge = Merge(Data2=rh_sel_btn)
expander = UiExpanderLayout(Elements=merge, Title="Start", Direction=0, Closed=True)

# ----
toggle = UiToggle(Label="Ignore Insertion Plane", State=False)
toggle_2 = UiToggle(Label="Flip Plane", State=False)

rh_sel_btn_2 = UiRhinoSelectButton(Label="Select Block", Filter=0)
button = UiButton(Label="Bake")
graphics_2 = UiSetGraphics(
    Element=rh_sel_btn_2,
    PrimaryColor=ColourSwatch(SwatchColor=RGB(79, 79, 79)),
    AccentColor=ColourSwatch(SwatchColor=RGB(255, 255, 255)),
    StrokeColor=ColourSwatch(SwatchColor=RGB(71, 71, 71)))
font_2 = UiSetFont(Element=rh_sel_btn_2, Size=Slider(12, range=0..100))
toggle_3 = UiToggle(Label="Preview Blocks", State=False)
get_values = UiValues(Element=toggle_3)
font_3 = UiSetFont(Element=button, Size=Slider(12, range=0..100))
graphics_3 = UiSetGraphics(
    Element=button,
    PrimaryColor=ColourSwatch(SwatchColor=RGB(79, 79, 79)),
    AccentColor=ColourSwatch(SwatchColor=RGB(255, 255, 255)),
    StrokeColor=ColourSwatch(SwatchColor=RGB(71, 71, 71)))
spacer = UiSpacer(Width=10, Horizontal=False)
merge_2 = Merge(Data2=rh_sel_btn_2, Data3=spacer, Data4=toggle, Data5=toggle_3, Data6=toggle_2, Data7=button)
expander_2 = UiExpanderLayout(Elements=merge_2, Title="Block Selection", Direction=0, Closed=True)

get_values_2 = UiValues(Element=toggle)
get_values_3 = UiValues(Element=toggle_2)
dropdown_list = UiDropdownList(Values=["Method 1", "Method 2", "Method 3"], Index=0)
get_values_4 = UiValues(Element=dropdown_list)
align = UiAlign(Element=button, Alignment=1)
resize = UiResize(Element=button, Height=Slider(60, range=0..100))

# ---- group: Turn on UI
toggle_4 = BooleanToggle(True)

# ----
get_values_5 = UiValues(Element=rh_sel_btn)
filtertype = FilterByType(ObjectType=["Brep", "Extrusion"], Geometry=get_values_5, invertFilter=False, returnNulls=False)  # -> ExcludedGeometry, flatten(IncludedGeometry)
brep = Brep(filtertype.IncludedGeometry)

filter = StreamFilter(Gate=get_values_3, Stream0="0", Stream1="1")
panel = Panel("0")
panel_2 = Panel("1")

dom = ConstructDomain(DomainStart="1", DomainEnd="6")
col = Colour(RGB(142, 68, 173))
col_2 = Colour([RGB(52, 152, 219), RGB(41, 128, 185), RGB(26, 188, 156), RGB(22, 160, 133), RGB(46, 204, 113), RGB(39, 174, 96), RGB(241, 196, 15), RGB(243, 156, 18), RGB(230, 126, 34), RGB(211, 84, 0), RGB(231, 76, 60), RGB(192, 57, 43), RGB(155, 89, 182), RGB(142, 68, 173), RGB(236, 240, 241), RGB(189, 195, 199), RGB(149, 165, 166), RGB(127, 140, 141), RGB(52, 73, 94), RGB(44, 62, 80)])
slider = UiSlider(Label="Grid Size", Value=Slider(1.15, range=0..3.5), Bounds=dom, Increment=Slider(0.05, range=0..0.1))
spacer_2 = UiSpacer(Width=Slider(2, range=0..10), Horizontal=invert(False))
color_palette_dropdown = UIColorPaletteDropdown(Color=col, Palette=col_2)  # -> flatten(Elements)
dom_2 = ConstructDomain(DomainStart=Slider(0, range=0..100), DomainEnd="100")
resize_2 = UiResize(Element=color_palette_dropdown, Width=Slider(29.3, range=0..50), Height=Slider(25.4, range=0..50))
swatch = ColourSwatch(SwatchColor=RGB(0, 0, 0))
get_values_6 = UiValues(Element=color_palette_dropdown)
layer_to_bake_to = Panel("Facade Paneling::")
gauge_chart = UiGaugeChart(
    Value=Slider(10, range=0..10),
    Domain=dom_2,
    InnerRadius=Slider(39, range=0..100),
    LowColor=ColourSwatch(SwatchColor=RGB(255, 0, 0)),
    HighColor=ColourSwatch(SwatchColor=RGB(81, 255, 0)))
toggle_5 = UiToggle(Label="Uniform Distribution", State=False)
toggle_6 = UiToggle(Label="Preview Grid", State=invert(False))
graphics_4 = UiSetGraphics(
    Element=slider,
    PrimaryColor=ColourSwatch(SwatchColor=RGB(0, 0, 0)),
    AccentColor=ColourSwatch(SwatchColor=RGB(255, 255, 255)),
    StrokeColor=ColourSwatch(SwatchColor=RGB(89, 89, 89)))
get_values_7 = UiValues(Element=slider)
graphics_5 = UiSetGraphics(Element=spacer_2, PrimaryColor=swatch, AccentColor=swatch)
concat = Concatenate(FragmentA=layer_to_bake_to, FragmentC="Grid Size::", FragmentB=get_values_7)
get_values_8 = UiValues(Element=toggle_5)
get_values_9 = UiValues(Element=toggle_6)
spacer_3 = UiSpacer(Width=10, Horizontal=False)
merge_3 = Merge(
    Data2=slider,
    Data3=toggle_5,
    Data5=toggle_6,
    Data6=dropdown_list,
    Data7=color_palette_dropdown,
    Data8=spacer_3,
    Data9=gauge_chart)
expander_3 = UiExpanderLayout(Elements=merge_3, Title="Grid Setup", Direction=0, Closed=True)

length_distance = RemoteSender(get_values_7)

# ----
# TURN ON UI
merge_4 = Merge(Data2=expander, Data3=expander_3, Data4=expander_2)
stack = UiStackLayout(Elements=merge_4, Horizontal=invert(True))
window = UiWindow(Elements=stack, Title="Control Panel", Owner=2, Scroll=False, Launch=toggle_4)
modify_win = UiModifyWindow(Window=window, Position="100,200", HideControls=Toggle(True), HideTitle=Toggle(True))

length_distance_2 = RemoteReceiver(length_distance)
length_distance_3 = RemoteReceiver(length_distance)

# ---- group: Create Grid
brep_2 = Brep(simplify(graft(brep)))
bbox = BoundingBox(Content=brep_2, Plane=PlaneXY(0, 0, 0), UnionBox=False)  # -> Box, Box_2
box_properties = BoxProperties(B=bbox.Box)  # -> out, xDim, yDim, simplify(zDim), bBasePt, bTopPoint, simplify(bCentre), bPts; inputs B: Box
# ---------- box_properties: Python ----------
"""
 A small utility to get some basic box properties
"""
import Rhino

"""
inputs:
    B= a or lisst of boxes (item access)

Outputs:
    xDim=   width of the box
    yDim= length of the box
    zDim= Height of the box
    
    bBasePointt= lowest point of the box (min x,y,z values)
    bTopPoint= highest point of the box (max x,y,z values)
    bCentre= centre point of the box
"""

ghenv.Component.Name = "Box Properties"
ghenv.Component.NickName = "Box Properties"

# Keep it in the "Performing" tab
ghenv.Component.Category = "Performing"

# Define the subcategory

#ghenv.Component.SubCategory = "1 Automation"
ghenv.Component.SubCategory = "2 Geometry"
#ghenv.Component.SubCategory = "3 Environmental"

try:
    
    xDim=B.X[1]-B.X[0]
    yDim=B.Y[1]-B.Y[0]
    zDim=B.Z[1]-B.Z[0]
    
    bBasePt=Rhino.Geometry.Point3d(B.X[0],B.Y[0],B.Z[0])
    bTopPoint=Rhino.Geometry.Point3d(B.X[1],B.Y[1],B.Z[1])
    
    bCentre=B.Center

except:
    print "please insert one or more valid bounding boxes as input"
# ---------- end box_properties ----------
xy = XYPlane(Origin=box_properties.bCentre)
division = Division(A=box_properties.zDim, B=2)
sec = BrepPlane(Brep=brep_2, Plane=xy)  # -> simplify(Curves), Points
Z = UnitZ(Factor=division)
neg = Negative(Value=Z)
move = Move(Geometry=sec.Curves, Motion=neg)  # -> Geometry, Transform
explode = Explode(Curve=move.Geometry, Recursive=True)  # -> simplify(Segments), Vertices
crv = Curve(simplify(explode.Segments))
ptdividelen = DivideLength(Curve=crv, Distance=length_distance_2, RoundUp=get_values_8, RoundDn=False)
Z_2 = UnitZ(Factor=box_properties.zDim)

# ----
divide_target = DivideByTargetLength(Curve=crv, Length=length_distance_3)  # -> Points, Tangents, Parameters
divlength = DivideLength(Curve=crv, Length=length_distance_3)  # -> Points, Tangents, Parameters
filter_2 = StreamFilter(Gate=get_values_4, Stream0=ptdividelen, Stream1=divide_target.Points, Stream2=divlength.Points)

# ---- group: Create Grid (continued)
pt = Point(filter_2)
move_2 = Move(Geometry=pt, Motion=Z_2)  # -> Geometry, Transform
merge_5 = Merge(Data1=pt, Data2=move_2.Geometry)
lng = ListLength(List=move_2.Geometry)
frompoints = MeshFromPoints(Points=merge_5, UDirection=2, VDirection=lng)
flip = MeshFlip(Mesh=frompoints)
explode_2 = MeshExplode(Mesh=flip, Interpolate=False)

# ----
clean = CleanTree(RemoveNulls=True, RemoveInvalid=True, RemoveEmpty=False, Tree=explode_2)

# ---- group: Create Planes For Block Insertion
mjoin = MeshJoin(Meshes=flatten(clean))
wbedges = WeaverbirdsMeshEdges(MeshOrPolylines=mjoin)
freeze_gate = StreamFreezeGate(Data=wbedges, PassingSwitch=get_values_9, Freeze=False)
previewlw = CustomPreviewLineweights(Geometry=freeze_gate, Shader=get_values_6, Thickness=Slider(0.1, range=0..0.2), Absolute=True)
wbfacepolys = WeaverbirdsFacePolylines(Mesh=clean)  # -> graft(Polygons)
facen = FaceNormals(Mesh=graft(clean))  # -> Centers, Normals
pl = PlaneNormal(Origin=facen.Centers, ZAxis=facen.Normals)
xz = XZPlane(Origin=Point(0, 0, 0))
align_2 = AlignPlanes(Planes=pl, Master=xz)
move_3 = Move(Geometry=wbfacepolys, Motion=facen.Normals)  # -> Geometry, Transform
merge_6 = Merge(Data1=wbfacepolys, Data2=move_3.Geometry)
group = Group(Objects=merge_6)
bbox_2 = BoundingBox(Content=group, Plane=align_2)  # -> Box, Box_2

# ---- group: Show Colors
box_properties_2 = BoxProperties(B=bbox_2.Box)  # -> out, xDim, yDim, zDim, bBasePt, bTopPoint, simplify(bCentre), bPts; inputs B: Box; same code as box_properties
roundd = RoundToDecimalPlace(NumberX=box_properties_2.xDim, DecimalPlace=2, RoundType=0)  # -> Rounded, Difference
subtraction = Subtraction(A=roundd.Rounded, B=get_values_7)
abs = Absolute(Value=subtraction)
gradient = Gradient(LowerLimit="0", UpperLimit="0.05", Parameter=abs, stops=[0.15: RGB(0, 255, 0), 0.85: RGB(255, 128, 0)])
freeze_gate_2 = StreamFreezeGate(Data=roundd.Rounded, PassingSwitch=get_values_9, Freeze=False)
freeze_gate_3 = StreamFreezeGate(Data=clean, PassingSwitch=get_values_9, Freeze=False)
tag = TextTag3D(Location=align_2, Text=freeze_gate_2, Size=Slider(0.4, range=0..1), Colour=get_values_6, Justification=5)
mcol = MeshColours(Mesh=graft(freeze_gate_3), Colours=gradient)

# ----
pflip = FlipPlane(Plane=align_2, ReverseX=invert(False), ReverseY=False, SwapAxes=invert(True))

# ---- group: Accuracy Analysis
item = ListItem(List=flatten(box_properties.zDim), Index=0, Wrap=True)
len = Length(Curve=wbedges)

# ----
custom_round = CustomRound(Numbers=item, Scope=Slider(0.01, range=0..0.01))
custom_round_2 = CustomRound(Numbers=len, Scope=Slider(0.01, range=0..0.01))

# ---- group: Accuracy Analysis (continued)
mindex = MemberIndex(Set=custom_round_2, Member=custom_round)  # -> Index, Count
cull_i = CullIndex(List=len, Indices=mindex.Index, Wrap=True)
subtraction_2 = Subtraction(A=cull_i, B=get_values_7)
equalst = EqualityWithinTolerance(FirstNumber=cull_i, SecondNumber=get_values_7, Tolerance=Slider(0.05, range=0..0.1))  # -> Equality, Inequality
ma = MassAddition(Input=cull_i)  # -> Result, PartialResults
abs_2 = Absolute(Value=subtraction_2)
ma_2 = MassAddition(Input=abs_2)  # -> Result, PartialResults
dispatch = Dispatch(List=cull_i, DispatchPattern=equalst.Equality)  # -> ListA, ListB
ma_3 = MassAddition(Input=dispatch.ListB)  # -> Result, PartialResults
ma_4 = MassAddition(Input=cull_i)  # -> Result, PartialResults
division_2 = Division(A=ma_2.Result, B=ma.Result)
division_3 = Division(A=ma_3.Result, B=ma_4.Result)
multiplication = Multiplication(A=division_2, B="100")
multiplication_2 = Multiplication(A=division_3, B="100")
subtraction_3 = Subtraction(A="100", B=multiplication)
subtraction_4 = Subtraction(A="100", B=multiplication_2)
roundd_2 = RoundToDecimalPlace(NumberX=subtraction_3, DecimalPlace=Slider(2, range=0..10), RoundType=0)  # -> Rounded, Difference
roundd_3 = RoundToDecimalPlace(NumberX=subtraction_4, DecimalPlace=Slider(2, range=0..10), RoundType=0)  # -> Rounded, Difference
panel_3 = Panel(roundd_2.Rounded)

# ----
gauge_chart_2 = UiGaugeChart(Element=gauge_chart, Value=roundd_2.Rounded, Circular=Toggle(True))

# ---- group: Place Blocks and Bake
get_values_10 = UiValues(Element=rh_sel_btn_2)
instancedecompose = InstanceDecompose(Instance=get_values_10)  # -> Definition, Plane, Transform, Box, XScale, YScale, ZScale
insert = InsertBlock(BlockName=instancedecompose.Definition, Plane=align_2)
box_properties_3 = BoxProperties(B=instancedecompose.Box)  # -> out, xDim, yDim, simplify(zDim), bBasePt, bTopPoint, simplify(bCentre), bPts; inputs B: Box; same code as box_properties
get_values_11 = UiValues(Element=button)
freeze_gate_4 = StreamFreezeGate(Data=concat, PassingSwitch=get_values_11, Freeze=False)
layers = CreateModifyLayers(LayerName=freeze_gate_4, LayerColor=get_values_6, DeleteLayer=False, enableFullPath=True)  # -> LayerNames, LayerFullPath
freeze_gate_5 = StreamFreezeGate(Data=get_values_11, PassingSwitch=get_values_11, Freeze=False)
ef_att = EleFrontAttributes(Layer=concat)  # -> Attributes, Keys, Values, Name, Layer, ColourSource, DisplayColour, MaterialSource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

# ----
blockexplode = BlockExplode(Definition=instancedecompose.Definition)  # -> Objects, Attribute, Guid, Boundingbox, References
bbox_3 = BoundingBox(Content=blockexplode.Objects, Plane=PlaneXY(0, 0, 0), UnionBox=True)  # -> Box, Box_2
transform = Transform(Geometry=bbox_3.Box, Transform=instancedecompose.Transform)
debrep = DeconstructBrep(Brep=transform)  # -> Faces, Edges, Vertices
area = Area(Geometry=debrep.Faces)  # -> Area, Centroid
cn = ClosestNumbers(NumberSet=area.Area, Search="1000", Count=1)
mindex_2 = MemberIndex(Set=area.Area, Member=cn)  # -> Index, Count
item_2 = ListItem(List=debrep.Faces, Index=mindex_2.Index, Wrap=True)
item_3 = ListItem(List=item_2, Index=filter, Wrap=True)
srfcenter = SurfaceCenter(Surface=item_3)  # -> Center, Normal, Frame

avr = Average(Input=flatten(box_properties_3.xDim))
avr_2 = Average(Input=flatten(box_properties_3.yDim))
avr_3 = Average(Input=flatten(box_properties_3.zDim))
sort = SortList(Keys=[avr, avr_2, avr_3])  # -> Keys, ValuesA
pflip_2 = FlipPlane(Plane=srfcenter.Frame, ReverseX=invert(False), ReverseY=False, SwapAxes=invert(True))
item_4 = ListItem(List=sort.Keys, Index=0, Wrap=True)  # -> Item, Item1, Item2
filter_3 = StreamFilter(Gate=get_values_3, Stream0=srfcenter.Frame, Stream1=pflip_2)
orient = Orient(Geometry=get_values_10, Source=filter_3, Target=align_2)  # -> simplify(Geometry), Transform
filter_4 = StreamFilter(Gate=get_values_2, Stream0=insert, Stream1=orient.Geometry)

# ---- group: Place Blocks and Bake (continued)
division_4 = Division(A=box_properties_2.xDim, B=item_4.Item1)
division_5 = Division(A=box_properties_2.yDim, B=item_4.Item2)
scale_nu = ScaleNU(Geometry=simplify(filter_4), Plane=simplify(align_2), ScaleX=simplify(division_4), ScaleY=simplify(division_5), ScaleZ=1)  # -> Geometry, Transform
freeze_gate_6 = StreamFreezeGate(Data=scale_nu.Geometry, PassingSwitch=get_values, Freeze=False)
expblock = ExplodeBlock(Block=freeze_gate_6, recursive=False)  # -> Name, Transform, Geometry
group_2 = Group(Objects=flatten(scale_nu.Geometry))
detatt = DetachAttributes(Geometry=expblock.Geometry)  # -> Geometry, Attributes
ef_att_2 = EleFrontAttributes(Attributes=detatt.Attributes)  # -> Attributes, Keys, Values, Name, Layer, ColourSource, DisplayColour, MaterialSource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
preview = CustomPreview(Geometry=detatt.Geometry, Material=ef_att_2.DisplayColour)
bake = BakeObjects(Geometry=group_2, Attributes=ef_att.Attributes, Bake=freeze_gate_5, createGroups=False)  # -> Message, Ghosts
