# Grasshopper definition block_geometry_check_up.gh (Grasshopper 1.0.8)
# plug-ins: Heteroptera, AstarPathFinder, Human, LegoPod, UiPlus, Wombat

# ---- group: Start
rh_sel_btn = UiRhinoSelectButton(Label="Select block", Filter=0)
graphics = UiSetGraphics(
    Element=rh_sel_btn,
    PrimaryColor=ColourSwatch(SwatchColor=RGB(79, 79, 79)),
    AccentColor=ColourSwatch(SwatchColor=RGB(255, 255, 255)),
    StrokeColor=ColourSwatch(SwatchColor=RGB(71, 71, 71)))
font = UiSetFont(Element=rh_sel_btn, Size=Slider(12, range=0..100))
merge = Merge(Data2=rh_sel_btn)
expander = UiExpanderLayout(Elements=merge, Title="Start", Direction=0, Closed=True)

# ----
get_values = UiValues(Element=rh_sel_btn)
lng = ListLength(List=get_values)
equals = Equality(FirstNumber=lng, SecondNumber=1)  # -> Equality, Inequality
list = ValueList({"One": 1, "Two": 2, "Three": 2² - 1, "Four": Sqrt(16)}, selected="Two")
concat = Concatenate(FragmentA=" Total Errors: ", FragmentB="0")
concat_2 = Concatenate(FragmentA="# Mirrored Blocks: ", FragmentB="0")
list_2 = ValueList({"One": 1, "Two": 2, "Three": 2² - 1, "Four": Sqrt(16)}, selected="Three")
instancedecompose = InstanceDecompose(Instance=get_values)  # -> Definition, Plane, Transform, Box, XScale, YScale, ZScale
concat_3 = Concatenate(FragmentA="# of Curves: ", FragmentB="0")
concat_4 = Concatenate(FragmentA="# Open Breps: ", FragmentB="0")
concat_5 = Concatenate(FragmentA="# Non Planar Surfaces: ", FragmentB="0")
concat_6 = Concatenate(FragmentA="# Points: ", FragmentB="0")
label = UiLabel(Label=concat, Style=list)
label_2 = UiLabel(Label=concat_4, Style=list_2)
label_3 = UiLabel(Label=concat_5, Style=list_2)
label_4 = UiLabel(Label=concat_2, Style=list_2)
label_5 = UiLabel(Label=concat_6, Style=list_2)
txt = Text(instancedecompose.Definition)
data = Data(txt)
lng_2 = ListLength(List=flatten(data))
series = Series(Start=0, Step=1, Count=lng_2)  # -> graft(Series)
bnd = Bounds(Numbers=flatten(series))
dedomain = DeconstructDomain(Domain=bnd)  # -> Start, End
gradient = Gradient(
    LowerLimit=dedomain.Start,
    UpperLimit=dedomain.End,
    Parameter=flatten(series),
    stops=[0.15: RGB(0, 255, 0), 0.85: RGB(220, 0, 40)])
blockexplode = BlockExplode(Definition=instancedecompose.Definition)  # -> Objects, Attribute, Guid, Boundingbox, References
concat_7 = Concatenate(FragmentA=data, FragmentB="#", FragmentC=series)
label_6 = UiLabel(Label=concat_3, Style=list_2)
matrix = TransformMatrix(instancedecompose.Transform, Digits=3)
bbox = BoundingBox(Content=blockexplode.Objects, Plane=PlaneXY(0, 0, 0), UnionBox=True)  # -> Box, Box_2
transform = Transform(Geometry=bbox.Box, Transform=instancedecompose.Transform)
pln = Plane(instancedecompose.Plane)
list_3 = ValueList({"One": 1, "Two": 2, "Three": 2² - 1, "Four": Sqrt(16)}, selected="Four")
debrep = DeconstructBrep(Brep=transform)  # -> Faces, Edges, Vertices
decompose = MatrixDecompose(Matrix=matrix)  # -> Scale, Rotation, Translation
area = Area(Geometry=debrep.Faces)  # -> Area, Centroid
cn = ClosestNumbers(NumberSet=area.Area, Search="1000", Count=1)
devec = DeconstructVector(Vector=decompose.Scale)  # -> XComponent, YComponent, ZComponent
mindex = MemberIndex(Set=area.Area, Member=cn)  # -> Index, Count
bar_chart = UiBarChart(Horizontal=invert(False), Type=0)
smaller = SmallerThan(FirstNumber=devec.XComponent, SecondNumber=0)  # -> SmallerThan, OrEqualTo
smaller_2 = SmallerThan(FirstNumber=devec.YComponent, SecondNumber=0)  # -> SmallerThan, OrEqualTo
item = ListItem(List=debrep.Faces, Index=mindex.Index, Wrap=True)
or = GateOr(A=smaller.SmallerThan, B=smaller_2.SmallerThan)
item_2 = ListItem(List=item, Index=0, Wrap=True)
avr = Average(Input=or)
srfcenter = SurfaceCenter(Surface=item_2)  # -> Center, Normal, Frame
entwine = Entwine(
    Branch01=expander,
    Branch02=label_6,
    Branch03=label_5,
    Branch04=label_2,
    Branch05=label_3,
    Branch06=label_4,
    FlattenInputs=True)  # -> flatten(Result)
bbox_2 = BoundingBox(Content=blockexplode.Objects, Plane=PlaneXY(0, 0, 0), UnionBox=True)  # -> Box, Box_2
mindex_2 = MemberIndex(Set=flatten(avr), Member=Slider(1, range=0..1))  # -> Index, Count
lng_3 = ListLength(List=mindex_2.Index)  # -> simplify(Length)
ma = MassAddition(Input=flatten(lng_3))  # -> Result, PartialResults
concat_8 = Concatenate(FragmentA="Mirrored Blocks: ", FragmentB=ma.Result)
label_7 = UiLabel(Element=label_4, Label=concat_8, Style=list_2)
transform_2 = Transform(Geometry=bbox_2.Box, Transform=instancedecompose.Transform)
expander_2 = UiExpanderLayout(Elements=entwine, Title="Errors found", Direction=0, Closed=True)
number_slider = Slider(0, range=0..100)
material = CreateMaterial(
    Diffuse=ColourSwatch(SwatchColor=RGB(255, 0, 0)),
    Specular=RGB(255, 255, 255),
    Emission=RGB(0, 0, 0),
    Transparency=0.5,
    Shine=0)
material_2 = CreateMaterial(
    Diffuse=ColourSwatch(SwatchColor=RGB(34, 255, 0)),
    Specular=RGB(255, 255, 255),
    Emission=RGB(0, 0, 0),
    Transparency=0.5,
    Shine=0)
swatch = ColourSwatch(SwatchColor=RGB(255, 0, 0))
preview = CustomPreview(Geometry=pln, Material=swatch)

sortbytype = SortObjectsByType(RhinoObjects=blockexplode.Objects)  # -> Points, Curves, Surfaces, Breps, Meshes, TextObjects, HatchObjects, LightObjects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
lng_4 = ListLength(List=sortbytype.Curves)
cloud = CloudDisplay(Points=sortbytype.Points, Colours=swatch, Size=Slider(0.1, range=0..1), SpriteType=0)

lng_5 = ListLength(List=sortbytype.Curves)  # -> simplify(Length)
lng_6 = ListLength(List=sortbytype.Points)  # -> simplify(Length)
ma_2 = MassAddition(Input=flatten(lng_5))  # -> Result, PartialResults
ma_3 = MassAddition(Input=flatten(lng_6))  # -> Result, PartialResults
concat_9 = Concatenate(FragmentA="Curves: ", FragmentB=ma_2.Result)
concat_10 = Concatenate(FragmentA="Points: ", FragmentB=ma_3.Result)
label_8 = UiLabel(Element=label_6, Label=concat_9, Style=list_2)
label_9 = UiLabel(Element=label_5, Label=concat_10, Style=list_2)

debrep_2 = DeconstructBrep(Brep=sortbytype.Breps)  # -> Faces, Edges, Vertices
txt_2 = Text(debrep_2.Edges)
mindex_3 = MemberIndex(Set=txt_2, Member="Circular Curve")  # -> Index, Count
lng_7 = ListLength(List=mindex_3.Index)
equals_2 = Equality(FirstNumber=lng_7, SecondNumber=0)  # -> Equality, Inequality
pshift = ShiftPaths(Data=equals_2.Equality, Offset=-2)
cull = CullPattern(List=blockexplode.Objects, CullPattern=pshift)

sortbytype_2 = SortObjectsByType(RhinoObjects=cull)  # -> Points, Curves, Surfaces, Breps, Meshes, TextObjects, HatchObjects, LightObjects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
txt_3 = Text(sortbytype_2.Breps)
tstat = TreeStatistics(Tree=sortbytype_2.Breps)  # -> Paths, Length, Count
mindex_4 = MemberIndex(Set=txt_3, Member="Open Brep")  # -> Index, Count
cset = CreateSet(List=txt_3)  # -> Set, Map
item_3 = ListItem(List=tstat.Paths, Index=-1, Wrap=True)
lng_8 = ListLength(List=cset.Set)
branch = TreeBranch(Tree=sortbytype_2.Breps, Path=item_3, MaintainPaths=True)
item_4 = ListItem(List=sortbytype_2.Breps, Index=mindex_4.Index, Wrap=True)

lng_9 = ListLength(List=item_4)  # -> simplify(Length)
ma_4 = MassAddition(Input=flatten(lng_9))  # -> Result, PartialResults
concat_11 = Concatenate(FragmentA="Open Breps: ", FragmentB=ma_4.Result)
label_10 = UiLabel(Element=label_2, Label=concat_11, Style=list_2)

debrep_3 = DeconstructBrep(Brep=sortbytype_2.Breps)  # -> Faces, Edges, Vertices
edges = BrepEdges(Brep=debrep_3.Faces)  # -> Naked, Interior, NonManifold
planar = IsPlanar(Surface=debrep_3.Faces, Interior=True)  # -> Planar, Plane
pshift_2 = ShiftPaths(Data=planar.Planar, Offset=-1)
pshift_3 = ShiftPaths(Data=debrep_3.Faces, Offset=-1)
mindex_5 = MemberIndex(Set=pshift_2, Member=Toggle(False))  # -> Index, Count
item_5 = ListItem(List=pshift_3, Index=mindex_5.Index, Wrap=True)
lng_10 = ListLength(List=item_5)
preview_2 = CustomPreview(Geometry=item_5, Material=swatch)

lng_11 = ListLength(List=item_5)  # -> simplify(Length)
ma_5 = MassAddition(Input=simplify(flatten([lng_5, lng_6, lng_9, lng_11])))  # -> Result, PartialResults
ma_6 = MassAddition(Input=simplify([lng_5, lng_6, lng_9, lng_11]))  # -> Result, PartialResults
filter = StreamFilter(Gate=equals.Equality, Stream0=ma_6.Result, Stream1=ma_5.Result)
num = Number(filter)
data_series = UIDataSeries(Label=simplify(series), Data=num, Type=2)  # -> flatten(DataSeries)
ma_7 = MassAddition(Input=flatten(lng_11))  # -> Result, PartialResults
ds_graphics = UiDataSeriesGraphics(
    DataSeries=data_series,
    PrimaryColor=flatten(gradient),
    AccentColor=flatten(ColourSwatch(SwatchColor=RGB(255, 255, 255))),
    Weight=Slider(0.5, range=0..1),
    Marker=list_3)
ds_labels = UiDataSeriesLabels(DataSeries=ds_graphics, Color=flatten(ColourSwatch(SwatchColor=RGB(255, 255, 255))), Prefix=flatten(concat_7))
concat_12 = Concatenate(FragmentA=" Total Errors: ", FragmentB=ma_5.Result)
concat_13 = Concatenate(FragmentA="Non Planar Surfaces: ", FragmentB=ma_7.Result)
label_11 = UiLabel(Element=label, Label=concat_12, Style=list)
label_12 = UiLabel(Element=label_3, Label=concat_13, Style=list_2)
bar_chart_2 = UiBarChart(Element=bar_chart, DataSeries=ds_labels, Horizontal=invert(False), Type=1)
entwine_2 = Entwine(Branch01=label, Branch02=bar_chart_2, FlattenInputs=True)  # -> flatten(Result)
expander_3 = UiExpanderLayout(Elements=entwine_2, Title="Graph", Direction=0, Closed=True)
entwine_3 = Entwine(Branch01=expander, Branch02=expander_2, Branch03=expander_3, FlattenInputs=True)  # -> flatten(Result)
stack = UiStackLayout(Elements=entwine_3, Horizontal=invert(True))
window = UiWindow(Elements=stack, Title="Control Panel", Owner=2, Scroll=False, Launch=Toggle(True))
modify_win = UiModifyWindow(Window=window, Position="100,200", HideControls=Toggle(True), HideTitle=Toggle(True))
preview_3 = CustomPreview(Geometry=item_4, Material=swatch)
ma_8 = MassAddition(Input=flatten([lng_4, lng_8, lng_10]))  # -> Result, PartialResults
larger = LargerThan(FirstNumber=ma_8.Result, SecondNumber=1)  # -> LargerThan, OrEqualTo
dispatch = Dispatch(List=transform_2, DispatchPattern=flatten(larger.LargerThan))  # -> ListA, ListB
preview_4 = CustomPreview(Geometry=dispatch.ListA, Material=material)
preview_5 = CustomPreview(Geometry=dispatch.ListB, Material=material_2)
previewlw = CustomPreviewLineweights(Geometry=sortbytype.Curves, Shader=swatch, Thickness=Slider(10, range=0..100), Absolute=False)
