# Grasshopper definition excel_to_rooms.ghx (Grasshopper 1.0.8)
# plug-ins: Heteroptera, Pufferfish, Bumblebee, Human, HAL for Grasshopper, opennest_2 Info, OpenNest, LunchBox, UiPlus, Wombat

sessionsettings = SessionSettings()  # -> Data, DefaultSettings
load_btn = UiLoadButton(Label="Load", Multiple=True)
series = Series(Start=0, Step=1, Count=10)
series_2 = Series(Start=0, Step=1, Count=10)
series_3 = Series(Start=0, Step=1, Count=10)
series_4 = Series(Start=0, Step=1, Count=10)
label = UiLabel(Label="Room Number")
dropdown_list = UiDropdownList(Values=series_4, Index=0)
label_2 = UiLabel(Label="Room Type")
dropdown_list_2 = UiDropdownList(Values=series, Index=1)
label_3 = UiLabel(Label="Number of Rooms")
dropdown_list_3 = UiDropdownList(Values=series_2, Index=2)
label_4 = UiLabel(Label="Room Area")
dropdown_list_4 = UiDropdownList(Values=series_3, Index=3)
get_values = UiValues(Element=dropdown_list)
get_values_2 = UiValues(Element=dropdown_list_2)
get_values_3 = UiValues(Element=dropdown_list_3)
get_values_4 = UiValues(Element=label_4)
get_values_5 = UiValues(Element=dropdown_list_4)
graphics = UiSetGraphics(
    Element=load_btn,
    PrimaryColor=ColourSwatch(SwatchColor=RGB(79, 79, 79)),
    AccentColor=ColourSwatch(SwatchColor=RGB(255, 255, 255)),
    StrokeColor=ColourSwatch(SwatchColor=RGB(71, 71, 71)))
font = UiSetFont(Element=load_btn, Size=Slider(12, range=0..100))
merge = Merge(
    Data2=flatten(label),
    Data3=flatten(dropdown_list),
    Data4=flatten(label_2),
    Data5=flatten(dropdown_list_2),
    Data6=flatten(label_3),
    Data7=flatten(dropdown_list_3),
    Data8=flatten(label_4),
    Data9=flatten(dropdown_list_4))
panel = Panel("Target Area")
panel_2 = Panel("Width")
panel_3 = Panel("Depth")
panel_4 = Panel("Ratio")
panel_5 = Panel("Difference")
number_slider = Slider(5, range=0..10)
dropdown_list_5 = UiDropdownList(Values="0")

# ---- group: Start
rh_sel_btn = UiRhinoSelectButton(Label="Select Massing", Filter=0)
toggle = UiToggle(Label="Refresh Layers", State=invert(False))
graphics_2 = UiSetGraphics(
    Element=rh_sel_btn,
    PrimaryColor=ColourSwatch(SwatchColor=RGB(79, 79, 79)),
    AccentColor=ColourSwatch(SwatchColor=RGB(255, 255, 255)),
    StrokeColor=ColourSwatch(SwatchColor=RGB(71, 71, 71)))
toggle_2 = UiToggle(Element=toggle, Label="Refresh Layers", State=invert(False))
font_2 = UiSetFont(Element=rh_sel_btn, Size=Slider(12, range=0..100))
get_values_6 = UiValues(Element=toggle_2)
merge_2 = Merge(Data2=load_btn, Data3=dropdown_list_5)
expander = UiExpanderLayout(Elements=merge_2, Title="Start", Direction=0, Closed=True)

# ----
dropdown_list_6 = UiDropdownList(Values=["Y Array", "XY Array"], Index=0)
slider = UiSlider(Label="Spacing", Value=5, Bounds=Domain(5, 20), Increment=0.1)
merge_3 = Merge(Data2=dropdown_list_6, Data3=slider)
expander_2 = UiExpanderLayout(Elements=merge, Title="Excel Settings", Direction=0, Closed=True)
graphics_3 = UiSetGraphics(
    Element=slider,
    PrimaryColor=ColourSwatch(SwatchColor=RGB(79, 79, 79)),
    AccentColor=ColourSwatch(SwatchColor=RGB(255, 255, 255)),
    StrokeColor=ColourSwatch(SwatchColor=RGB(71, 71, 71)))
font_3 = UiSetFont(Element=slider, Size=Slider(12, range=0..100))
expander_3 = UiExpanderLayout(Elements=merge_3, Title="Room Graph", Direction=0, Closed=True)

# ---- group: Turn on UI
toggle_3 = BooleanToggle(True)

# ----
# TURN ON UI
merge_4 = Merge(Data1=expander, Data2=expander_2, Data3=expander_3)
stack = UiStackLayout(Elements=merge_4, Horizontal=invert(True))
window = UiWindow(Elements=stack, Title="Control Panel", Owner=2, Scroll=invert(False), Launch=toggle_3)
graphics_4 = UiSetGraphics(
    Element=merge_4,
    PrimaryColor=ColourSwatch(SwatchColor=RGB(0, 0, 0)),
    AccentColor=ColourSwatch(SwatchColor=RGB(255, 255, 255)))
modify_win = UiModifyWindow(Window=window, Position="100,200", HideControls=Toggle(True), HideTitle=Toggle(True))

# ---- group: Empty
data = Data("")

# ----
get_values_7 = UiValues(Element=slider)
Y = UnitY(Factor="-10")

get_values_8 = UiValues(Element=load_btn)
load_workbook = LoadWorkbook(ExcelApplication="Excel Application", FilePath=get_values_8)
get_worksheets = GetWorksheets(Workbook=load_workbook)
split = TextSplit(Text=get_worksheets, Separators="|")
item = ListItem(List=split, Index=-1, Wrap=True)
trim = TextTrim(Text=item, Start=True, End=True)  # -> flatten(Result)

dropdown_list_7 = UiDropdownList(Element=dropdown_list_5, Values=trim)

get_values_9 = UiValues(Element=dropdown_list_7)
item_2 = ListItem(List=trim, Index=get_values_9, Wrap=True)
txt = Text(item_2)
get_worksheet = GetWorksheet(Workbook=load_workbook, Name=txt)
live_worksheet = LiveWorksheet(Worksheet=get_worksheet, Activate=Toggle(True))
xl_read = ReadData(Worksheet=live_worksheet, Activate=Toggle(True))  # -> Range, Data

cluster = Cluster(D=xl_read.Data, i="4")
cluster_2 = Cluster(D=xl_read.Data, i="7")
cluster_3 = Cluster(D=xl_read.Data, i="1")
cluster_4 = Cluster(D=xl_read.Data, i="2")
mindex = MemberIndex(Set=cluster, Member=data)  # -> Index, Count
consec = ConsecutiveDomains(Numbers=mindex.Index, Additive=invert(True))
subset = SubList(List=cluster, Domain=consec, Wrap=True)  # -> simplify(List), Index

panel_6 = Panel(cluster)

# ---- group: Program Description
subset_2 = SubList(List=cluster_3, Domain=consec, Wrap=True)  # -> simplify(List), Index

# ---- group: Number of rooms
subset_3 = SubList(List=cluster_4, Domain=consec, Wrap=True)  # -> simplify(List), Index

# ---- group: Program Area
subset_4 = SubList(List=cluster_2, Domain=consec, Wrap=True)  # -> simplify(List), Index

# ---- group: General Categories
item_3 = ListItem(List=subset_2.List, Index=0, Wrap=True)

# ---- group: Y
cull_ends = CullEnds(List=subset_4.List)  # -> List, Culled

# ---- group: X
cull_ends_2 = CullEnds(List=subset.List)  # -> List, Culled

# ----
cull_ends_3 = CullEnds(List=subset_3.List)  # -> List, Culled
cull_ends_4 = CullEnds(List=subset_2.List)  # -> List, Culled
stack_2 = StackData(Data=cull_ends_4.List, Stack=cull_ends_3.List)
stack_3 = StackData(Data=cull_ends_2.List, Stack=cull_ends_3.List)
stack_4 = StackData(Data=cull_ends.List, Stack=cull_ends_3.List)
division = Division(A=stack_3, B=2)
division_2 = Division(A=stack_4, B=2)
extremums = MinMax(Number=flatten(stack_3))  # -> Minimum, Maximum
extremums_2 = MinMax(Number=flatten(stack_4))  # -> Minimum, Maximum
lng = ListLength(List=flatten(stack_3))
neg = Negative(Value=division)
neg_2 = Negative(Value=division_2)
gridizer = NumberGrid(Number=lng, RowSize=Slider(8, range=0..15), X=extremums.Maximum, Y=extremums_2.Maximum)  # -> Column, Row, Vectors
dom = ConstructDomain(DomainStart=division_2, DomainEnd=neg_2)
dom_2 = ConstructDomain(DomainStart=division, DomainEnd=neg)
tstat = TreeStatistics(Tree=stack_3)  # -> Paths, Length, Count
pt = Point(gridizer.Vectors)
xy = XYPlane(Origin=pt)
partition = PartitionList(List=xy, Size=tstat.Length)
rectangle = Rectangle(Plane=partition, XSize=dom_2, YSize=dom, Radius=0)  # -> Rectangle, Length
clean = CleanTree(RemoveNulls=True, RemoveInvalid=True, RemoveEmpty=invert(False), Tree=rectangle.Rectangle)

tstat_2 = TreeStatistics(Tree=clean)  # -> Paths, Length, Count
area = Area(Geometry=clean)  # -> flatten(Area), Centroid
lng_2 = ListLength(List=tstat_2.Paths)
avr = Average(Input=area.Area)
get_values_10 = UiValues(Element=dropdown_list_6)
boundary = BoundarySurfaces(Edges=clean)
multiplication = Multiplication(A=avr, B=Slider(2, range=0..10))
gridizer_2 = NumberGrid(Number=lng_2, RowSize=Slider(4, range=0..15), X=multiplication, Y=multiplication)  # -> Column, Row, Vectors
equals = Equality(FirstNumber=get_values_10, SecondNumber=1)  # -> Equality, Inequality
freeze_gate = StreamFreezeGate(Data=gridizer_2.Vectors, PassingSwitch=equals.Equality, Freeze=False)
rectangle_2 = Rectangle(Plane=freeze_gate, XSize=multiplication, YSize=multiplication, Radius=0)  # -> Rectangle, Length
pcent = Percentage(Number=multiplication, Percent=Slider(5, range=0..10))
neg_3 = Negative(Value=pcent)
offset = OffsetCurve(Curve=rectangle_2.Rectangle, Distance=neg_3, Corners=1)
opennest = OpenNest(
    Sheets=simplify(offset),
    Geo=simplify(boundary),
    Spacing=1,
    Placement=1,
    Tolerance=0.1,
    Rotations=Slider(1, range=0..1),
    Iterations=1,
    Seed=1,
    Reset=Button(),
    Run=Toggle(False))  # -> Sheets, Geo, ID, Transform, IDS
previewlw = CustomPreviewLineweights(
    Geometry=rectangle_2.Rectangle,
    Shader=ColourSwatch(SwatchColor=RGB(79, 79, 79)),
    Thickness=Slider(1, range=0..10),
    Absolute=False)

drec = DeconstructRectangle(Rectangle=clean)  # -> BasePlane, XInterval, YInterval
sort = SortList(Keys=flatten(drec.YInterval))  # -> Keys, ValuesA
rev = ReverseList(List=sort.Keys)
center = Center(Geometry=clean)  # -> Center, Dimension
item_4 = ListItem(List=rev, Index=0, Wrap=True)
xy_2 = XYPlane(Origin=center.Center)
addition = Addition(A=item_4, B=get_values_7)
pack = PackObjects(Geo=boundary, Plane=xy_2, X=1, Y=addition, Tolerance=0)  # -> Geo, Transformation

brec = BoundingRectangle(Geometry=pack.Geo, Plane=PlaneXY(0, 0, 0), Axis=0, Slide=0, Union=True)  # -> Bounding, DimensionX, DimensionY
center_2 = Center(Geometry=brec.Bounding)  # -> Center, Dimension
scale_nu = ScaleNU(Geometry=brec.Bounding, Plane=center_2.Center, ScaleX=1, ScaleY=Slider(1, range=0..10), ScaleZ=1)  # -> Geometry, Transform
get_values_11 = UiValues(Element=dropdown_list_6)
equals_2 = Equality(FirstNumber=get_values_11, SecondNumber=0)  # -> Equality, Inequality
freeze_gate_2 = StreamFreezeGate(Data=scale_nu.Geometry, PassingSwitch=equals_2.Equality, Freeze=False)
disc = Discontinuity(Curve=freeze_gate_2, Level=1)  # -> Points, Parameters
item_5 = ListItem(List=disc.Points, Index=0, Wrap=True)
previewlw_2 = CustomPreviewLineweights(
    Geometry=freeze_gate_2,
    Shader=ColourSwatch(SwatchColor=RGB(79, 79, 79)),
    Thickness=Slider(1, range=0..10),
    Absolute=False)
tag = TextTag3D(
    Location=item_5,
    Text=item_3,
    Size=Slider(1.46, range=0..10),
    Colour=graft(ColourSwatch(SwatchColor=RGB(0, 0, 0))),
    Justification=1)

center_3 = Center(Geometric=opennest.Sheets)  # -> Center, Dimension
division_3 = Division(A=multiplication, B=2.2)
Y_2 = UnitY(Factor=division_3)
move = Move(Geometry=center_3.Center, Motion=Y_2)  # -> Geometry, Transform
tag_2 = TextTag3D(
    Location=move.Geometry,
    Text=item_3,
    Size=Slider(1.46, range=0..10),
    Colour=graft(ColourSwatch(SwatchColor=RGB(0, 0, 0))),
    Justification=5)

filter = StreamFilter(Gate=get_values_10, Stream0=pack.Geo, Stream1=opennest.Geo)
geo = Geometry(filter)
center_4 = Center(Geometric=geo)  # -> Center, Dimension
geo_2 = Geometry(geo)
Z = UnitZ(Factor="4.5")
vec = VectorXYZ(XComponent=Slider(-2, range=-10..10), YComponent=Slider(-3, range=-10..10), ZComponent=Slider(6, range=0..10))  # -> Vector, Length
tag_3 = TextTag(Location=center_4.Center, Text=subset_2.List)
extr = Extrude(Base=geo_2, Direction=Z)
move_2 = Move(Geometry=center_4.Center, Motion=Z)  # -> Geometry, Transform
mshadow = MeshShadow(Mesh=extr, Light=vec.Vector, Plane=PlaneXY(0, 0, 0))
phatch = PatternHatch(Boundaries=mshadow, Pattern=Slider(1, range=0..10), Scale=Slider(3, range=0..10), Angle=0)
series_5 = Series(Start=0, Step=1, Count=tstat_2.Count)
gradient = Gradient(
    LowerLimit=0,
    UpperLimit=tstat_2.Count,
    Parameter=series_5,
    stops=[0: RGB(243, 57, 0), 0.1: RGB(236, 27, 60), 0.2: RGB(210, 0, 118), 0.3: RGB(103, 0, 120), 0.4: RGB(39, 72, 161), 0.5: RGB(1, 192, 229), 0.6: RGB(18, 178, 90), 0.7: RGB(79, 186, 8), 0.8: RGB(220, 237, 32), 0.9: RGB(247, 159, 20), 1: RGB(243, 57, 0)])
preview = CustomPreview(Geometry=extr, Material=graft(gradient))

brec_2 = BoundingRectangle(Geometry=flatten(geo), Plane=PlaneXY(0, 0, 0), Axis=0, Slide=0, Union=True)  # -> Bounding, DimensionX, DimensionY
disc_2 = Discontinuity(Curve=brec_2.Bounding, Level=1)  # -> Points, Parameters
item_6 = ListItem(List=disc_2.Points, Index=0, Wrap=True)
move_3 = Move(Geometry=item_6, Motion=Y)  # -> Geometry, Transform
area_2 = Area(Geometry=geo)  # -> Area, Centroid

division_4 = Division(A=multiplication, B=2.5)
Y_3 = UnitY(Factor=division_4)
move_4 = Move(Geometry=center_3.Center, Motion=Y_3)  # -> Geometry, Transform
ma = MassAddition(Input=area_2.Area)  # -> Result, PartialResults
roundd = RoundToDecimalPlace(NumberX=ma.Result, DecimalPlace=Slider(2, range=0..10), RoundType=0)  # -> Rounded, Difference
ma_2 = MassAddition(Input=flatten(roundd.Rounded))  # -> Result, PartialResults
pt_2 = Point(move_3.Geometry)
concat = Concatenate(FragmentA=roundd.Rounded, FragmentB=" m2")
concat_2 = Concatenate(FragmentA="Total Area   ", FragmentB=ma_2.Result, FragmentC=" m2")
swatch = ColourSwatch(SwatchColor=RGB(0, 0, 0))

# ---- group: Total Area
tag_4 = TextTag3D(Location=pt_2, Text=concat_2, Size="3", Colour=graft(swatch), Justification=7)

# ---- group: Areas
tag_5 = TextTag3D(Location=move_4.Geometry, Text=concat, Size=Slider(1.46, range=0..10), Colour=graft(swatch), Justification=5)

# ----
move_5 = Move(Geometry=geo_2, Motion=Z)  # -> Geometry, Transform
wires = BrepWireframe(Brep=move_5.Geometry, Density=-1)
split_2 = TextSplit(Text=stack_2, Separators=" ")
item_7 = ListItem(List=wires, Index=-1, Wrap=True)
lng_3 = ListLength(List=split_2)
addition_2 = Addition(A=lng_3, B=1)
divide = DivideCurve(Curve=item_7, Count=addition_2, Kinks=False)  # -> Points, Tangents, Parameters
cull_ends_5 = CullEnds(List=divide.Points)  # -> List, Culled
lng_4 = ListLength(List=split_2)
dom_3 = ConstructDomain(DomainStart=Slider(0.23, range=0..1), DomainEnd=Slider(3.27, range=0..10))

area_3 = Area(Geometry=move_5.Geometry)  # -> Area, Centroid

bnd = Bounds(Numbers=flatten(area_3.Area))
remap = RemapNumbers(Value=area_3.Area, Source=bnd, Target=dom_3)  # -> Mapped, Clipped
stack_5 = StackData(Data=graft(remap.Mapped), Stack=lng_4)

ma_3 = MassAddition(Input=area_3.Area)  # -> flatten(Result), PartialResults
bnd_2 = Bounds(Numbers=flatten(ma_3.Result))
dedomain = DeconstructDomain(Domain=flatten(bnd_2))  # -> Start, End
gradient_2 = Gradient(
    LowerLimit=dedomain.End,
    UpperLimit=dedomain.Start,
    Parameter=flatten(ma_3.Result),
    stops=[0.0798: RGB(234, 38, 0), 0.244: RGB(234, 126, 0), 0.683: RGB(254, 244, 84), 0.877: RGB(173, 203, 249), 0.992: RGB(75, 107, 169)])
boundary_2 = BoundarySurfaces(Edges=flatten(rectangle_2.Rectangle))
bake = ObjectBake(
    BakeToggle=Button(),
    GeometryObjects=boundary_2,
    Layer="Total Areas",
    ObjectName="GH_Obj",
    ObjectColor=gradient_2,
    LayerColor=RGB(255, 255, 255))
bake_2 = ObjectBake(
    BakeToggle=Button(),
    GeometryObjects=extr,
    Layer=item_3,
    ObjectName=stack_2,
    ObjectColor=graft(gradient),
    LayerColor=graft(gradient))
previewmat = CustomPreviewMaterials(Geometry=boundary_2, DiffuseColor=gradient_2, Transparency=Slider(0.3, range=0..1))

# ---- group: Bake
tag_6 = TextTag3D(
    Location=cull_ends_5.List,
    Text=split_2,
    Size=stack_5,
    Colour=ColourSwatch(SwatchColor=RGB(255, 255, 255)),
    Justification=4)

# ==== cluster Cluster
D = ClusterInput()
flip = FlipMatrix(Data=D)
tstat = TreeStatistics(Tree=flip)  # -> Paths, Length, Count
i = ClusterInput()
item = ListItem(List=tstat.Paths, Index=i, Wrap=True)
branch = TreeBranch(Tree=flip, Path=item, MaintainPaths=True)
B = ClusterOutput(branch)
