# Grasshopper definition program_330_existing_building.gh (Grasshopper 1.0.8)
# plug-ins: Heteroptera, Pufferfish, Bumblebee, Human, OpenNest, LunchBox, Wombat

path = FilePath("\\berlin152\Office\03_Library\10 GH SCRIPTS\Tool Catalogue\AreaTools\Excel to Room Advanced\Raumprogram_Script_JME.xlsx")
load_workbook = LoadWorkbook(ExcelApplication="Excel Application", FilePath=path)
get_worksheet = GetWorksheet(Workbook=load_workbook, Name="BMZ Office")
live_worksheet = LiveWorksheet(Worksheet=get_worksheet, Activate=Toggle(True))
xl_read = ReadData(Worksheet=live_worksheet, Range="A1:J69", Activate=Toggle(True))  # -> Range, Data
cluster = Cluster(D=xl_read.Data, i="4")
cluster_2 = Cluster(D=xl_read.Data, i="7")
cluster_3 = Cluster(D=xl_read.Data, i="1")
cluster_4 = Cluster(D=xl_read.Data, i="2")

# ---- group: Empty
data = Data("")

# ----
mindex = MemberIndex(Set=cluster, Member=data)  # -> Index, Count
consec = ConsecutiveDomains(Numbers=mindex.Index, Additive=invert(True))

# ---- group: Program Description
subset = SubList(List=cluster_3, Domain=consec, Wrap=True)  # -> simplify(List), Index

# ---- group: Number of rooms
subset_2 = SubList(List=cluster_4, Domain=consec, Wrap=True)  # -> simplify(List), Index

# ---- group: Program Area
subset_3 = SubList(List=cluster_2, Domain=consec, Wrap=True)  # -> simplify(List), Index

# ----
subset_4 = SubList(List=cluster, Domain=consec, Wrap=True)  # -> simplify(List), Index
cull_ends = CullEnds(List=subset_2.List)  # -> List, Culled

# ---- group: General Categories
item = ListItem(List=subset.List, Index=0, Wrap=True)

# ----
cull_ends_2 = CullEnds(List=subset.List)  # -> List, Culled

# ---- group: Y
cull_ends_3 = CullEnds(List=subset_3.List)  # -> List, Culled

# ---- group: X
cull_ends_4 = CullEnds(List=subset_4.List)  # -> List, Culled

# ----
stack = StackData(Data=cull_ends_2.List, Stack=cull_ends.List)
stack_2 = StackData(Data=cull_ends_4.List, Stack=cull_ends.List)
stack_3 = StackData(Data=cull_ends_3.List, Stack=cull_ends.List)
division = Division(A=stack_2, B=2)
division_2 = Division(A=stack_3, B=2)
extremums = MinMax(Number=flatten(stack_2))  # -> Minimum, Maximum
extremums_2 = MinMax(Number=flatten(stack_3))  # -> Minimum, Maximum
lng = ListLength(List=flatten(stack_2))
neg = Negative(Value=division)
neg_2 = Negative(Value=division_2)
gridizer = NumberGrid(Number=lng, RowSize=Slider(8, range=0..15), X=extremums.Maximum, Y=extremums_2.Maximum)  # -> Column, Row, Vectors
dom = ConstructDomain(DomainStart=division_2, DomainEnd=neg_2)
dom_2 = ConstructDomain(DomainStart=division, DomainEnd=neg)
tstat = TreeStatistics(Tree=stack_2)  # -> Paths, Length, Count
pt = Point(gridizer.Vectors)
xy = XYPlane(Origin=pt)
partition = PartitionList(List=xy, Size=tstat.Length)
tstat_2 = TreeStatistics(Tree=partition)  # -> Paths, Length, Count
rectangle = Rectangle(Plane=partition, XSize=dom_2, YSize=dom, Radius=0)  # -> Rectangle, Length
tstat_3 = TreeStatistics(Tree=rectangle.Rectangle)  # -> Paths, Length, Count
number_slider = Slider(140, range=0..200)
lng_2 = ListLength(List=flatten(tstat_3.Paths))
area = Area(Geometry=rectangle.Rectangle)  # -> Area, Centroid
gridizer_2 = NumberGrid(Number=lng_2, RowSize=Slider(4, range=0..15), X=number_slider, Y=number_slider)  # -> Column, Row, Vectors
pcent = Percentage(Number=number_slider, Percent=Slider(5, range=0..10))
number_slider_2 = Slider(350, range=0..1000)  # disabled
number_slider_3 = Slider(250, range=0..1000)  # disabled
sort = SortList(Keys=flatten(area.Area), ValuesA=flatten(rectangle.Rectangle))  # -> Keys, ValuesA
rectangle_2 = Rectangle(Plane=gridizer_2.Vectors, XSize=number_slider, YSize=number_slider, Radius=0)  # -> Rectangle, Length
boundary = BoundarySurfaces(Edges=rectangle.Rectangle)
neg_3 = Negative(Value=pcent)
index = ItemIndex(List=flatten(rectangle.Rectangle), Item=sort.ValuesA)
offset = OffsetCurve(Curve=rectangle_2.Rectangle, Distance=neg_3, Corners=1)
rectangle_3 = Rectangle(Plane=PlaneXY(0, 0, 0), XSize=number_slider_3, YSize=number_slider_3, Radius=0)  # -> Rectangle, Length; disabled
X = UnitX(Factor=number_slider_2)  # disabled
number_slider_4 = Slider(500, range=0..1000)  # disabled
number_slider_5 = Slider(250, range=0..1000)  # disabled
item_2 = ListItem(List=rectangle.Rectangle, Index=index, Wrap=True)
number_slider_6 = Slider(1, range=0..1)  # disabled
move = Move(Geometry=rectangle_3.Rectangle, Motion=X)  # -> Geometry, Transform; disabled
toggle = BooleanToggle(False)  # disabled
button = Button()  # disabled
opennest = OpenNest(
    Sheets=simplify(graft(offset)),
    Geo=simplify(boundary),
    Spacing=1,
    Placement=1,
    Tolerance=0.1,
    Rotations=Slider(1, range=0..1),
    Iterations=1,
    Seed=1,
    Reset=Button(),
    Run=Toggle(False))  # -> Sheets, Geo, ID, Transform, IDS
rectangle_4 = Rectangle(Plane=PlaneXY(0, 0, 0), XSize=number_slider_5, YSize=number_slider_5, Radius=0)  # -> Rectangle, Length; disabled
X_2 = UnitX(Factor=number_slider_4)  # disabled
number_slider_7 = Slider(1, range=0..1)  # disabled
opennest_2 = OpenNest(
    Sheets=move.Geometry,
    Geo=flatten(boundary),
    Spacing=1,
    Placement=1,
    Tolerance=0.1,
    Rotations=number_slider_6,
    Iterations=1,
    Seed=1,
    Reset=button,
    Run=toggle)  # -> Sheets, Geo, ID, Transform, IDS; disabled
number_slider_8 = Slider(5, range=0..10)  # disabled
number_slider_9 = Slider(2, range=0..10)  # disabled
toggle_2 = BooleanToggle(False)  # disabled
button_2 = Button()  # disabled
move_2 = Move(Geometry=rectangle_4.Rectangle, Motion=X_2)  # -> Geometry, Transform; disabled
previewlw = CustomPreviewLineweights(
    Geometry=rectangle_2.Rectangle,
    Shader=ColourSwatch(SwatchColor=RGB(79, 79, 79)),
    Thickness=Slider(1, range=0..10),
    Absolute=False)
center = Center(Geometric=opennest.Sheets)  # -> Center, Dimension
center_2 = Center(Geometric=opennest.Geo)  # -> Center, Dimension
geo = Geometry(opennest.Geo)
tstat_4 = TreeStatistics(Tree=geo)  # -> Paths, Length, Count; disabled
number_slider_10 = Slider(-2, range=-10..10)  # disabled
number_slider_11 = Slider(-3, range=-10..10)  # disabled
number_slider_12 = Slider(6, range=0..10)  # disabled
opennest_3 = OpenNest(
    Sheets=move_2.Geometry,
    Geo=simplify(flatten(boundary)),
    Spacing=1,
    Placement=number_slider_8,
    Tolerance=0.1,
    Rotations=number_slider_7,
    Iterations=1,
    Seed=number_slider_9,
    Reset=button_2,
    Run=toggle_2)  # -> Sheets, Geo, ID, Transform, IDS; disabled
panel = Panel("4.5")  # disabled
Z = UnitZ(Factor="4.5")
partition_2 = PartitionList(List=opennest_2.Geo, Size=tstat_4.Length)  # disabled
center_3 = Center(Geometric=opennest_2.Geo)  # -> Center, Dimension; disabled
geo_2 = Geometry(partition_2)  # disabled
Z_2 = UnitZ(Factor=panel)  # disabled
vec = VectorXYZ(XComponent=Slider(-2, range=-10..10), YComponent=Slider(-3, range=-10..10), ZComponent=Slider(6, range=0..10))  # -> Vector, Length
tag = TextTag(Location=center_2.Center, Text=subset.List)
extr = Extrude(Base=geo, Direction=Z)
extr_2 = Extrude(Base=geo_2, Direction=Z_2)  # disabled
number_slider_13 = Slider(-2, range=-10..10)  # disabled
number_slider_14 = Slider(-3, range=-10..10)  # disabled
number_slider_15 = Slider(6, range=0..10)  # disabled
vec_2 = VectorXYZ(XComponent=number_slider_10, YComponent=number_slider_11, ZComponent=number_slider_12)  # -> Vector, Length; disabled
tag_2 = TextTag(Location=center_3.Center, Text=subset.List)  # disabled
geo_3 = Geometry(opennest_3.Geo)  # disabled
panel_2 = Panel("4.5")  # disabled
division_3 = Division(A=number_slider, B=2.2)
move_3 = Move(Geometry=center_2.Center, Motion=Z)  # -> Geometry, Transform
center_4 = Center(Geometric=opennest_3.Geo)  # -> Center, Dimension; disabled
center_5 = Center(Geometric=opennest_3.Sheets)  # -> Center, Dimension; disabled
mshadow = MeshShadow(Mesh=extr, Light=vec.Vector, Plane=PlaneXY(0, 0, 0))
Z_3 = UnitZ(Factor=panel_2)  # disabled
move_4 = Move(Geometry=center_3.Center, Motion=Z_2)  # -> Geometry, Transform; disabled
Y = UnitY(Factor=division_3)
mshadow_2 = MeshShadow(Mesh=extr_2, Light=vec_2.Vector, Plane=PlaneXY(0, 0, 0))  # disabled
number_slider_16 = Slider(3, range=0..10)  # disabled
number_slider_17 = Slider(1, range=0..10)  # disabled
division_4 = Division(A=number_slider, B=2.5)
extr_3 = Extrude(Base=geo_3, Direction=Z_3)  # disabled
vec_3 = VectorXYZ(XComponent=number_slider_13, YComponent=number_slider_14, ZComponent=number_slider_15)  # -> Vector, Length; disabled
tag_3 = TextTag(Location=center_4.Center, Text=subset.List)  # disabled
move_5 = Move(Geometry=center.Center, Motion=Y)  # -> Geometry, Transform
phatch = PatternHatch(Boundaries=mshadow, Pattern=Slider(1, range=0..10), Scale=Slider(3, range=0..10), Angle=0)
Y_2 = UnitY(Factor=division_4)
division_5 = Division(A=number_slider, B=2.2)  # disabled
move_6 = Move(Geometry=center_4.Center, Motion=Z_3)  # -> Geometry, Transform; disabled
phatch_2 = PatternHatch(Boundaries=mshadow_2, Pattern=number_slider_17, Scale=number_slider_16, Angle=0)  # disabled
mshadow_3 = MeshShadow(Mesh=extr_3, Light=vec_3.Vector, Plane=PlaneXY(0, 0, 0))  # disabled
number_slider_18 = Slider(1, range=0..10)  # disabled
number_slider_19 = Slider(3, range=0..10)  # disabled
series = Series(Start=0, Step=1, Count=tstat_3.Count)
tag_4 = TextTag3D(
    Location=move_5.Geometry,
    Text=item,
    Size=Slider(1.46, range=0..10),
    Colour=graft(ColourSwatch(SwatchColor=RGB(0, 0, 0))),
    Justification=5)
move_7 = Move(Geometry=center.Center, Motion=Y_2)  # -> Geometry, Transform
Y_3 = UnitY(Factor=division_5)  # disabled
series_2 = Series(Start=0, Step=1, Count=tstat_3.Count)  # disabled
area_2 = Area(Geometry=opennest.Geo)  # -> Area, Centroid
gradient = Gradient(
    LowerLimit=0,
    UpperLimit=tstat_3.Count,
    Parameter=series,
    stops=[0: RGB(243, 57, 0), 0.1: RGB(236, 27, 60), 0.2: RGB(210, 0, 118), 0.3: RGB(103, 0, 120), 0.4: RGB(39, 72, 161), 0.5: RGB(1, 192, 229), 0.6: RGB(18, 178, 90), 0.7: RGB(79, 186, 8), 0.8: RGB(220, 237, 32), 0.9: RGB(247, 159, 20), 1: RGB(243, 57, 0)])
gradient_2 = Gradient(
    LowerLimit=0,
    UpperLimit=tstat_3.Count,
    Parameter=series_2,
    stops=[0: RGB(243, 57, 0), 0.1: RGB(236, 27, 60), 0.2: RGB(210, 0, 118), 0.3: RGB(103, 0, 120), 0.4: RGB(39, 72, 161), 0.5: RGB(1, 192, 229), 0.6: RGB(18, 178, 90), 0.7: RGB(79, 186, 8), 0.8: RGB(220, 237, 32), 0.9: RGB(247, 159, 20), 1: RGB(243, 57, 0)])  # disabled
phatch_3 = PatternHatch(Boundaries=mshadow_3, Pattern=number_slider_18, Scale=number_slider_19, Angle=0)  # disabled
ma = MassAddition(Input=area_2.Area)  # -> Result, PartialResults
pt_2 = Point("30,-10,0")
series_3 = Series(Start=0, Step=1, Count=tstat_3.Count)  # disabled
roundd = RoundToDecimalPlace(NumberX=ma.Result, DecimalPlace=Slider(2, range=0..10), RoundType=0)  # -> Rounded, Difference
ma_2 = MassAddition(Input=flatten(roundd.Rounded))  # -> Result, PartialResults
number_slider_20 = Slider(92, range=0..100)  # disabled
preview = CustomPreview(Geometry=extr, Material=graft(gradient))
concat = Concatenate(FragmentA=roundd.Rounded, FragmentB=" m2")
concat_2 = Concatenate(FragmentA="Total Area   ", FragmentB=ma_2.Result, FragmentC=" m2")
preview_2 = CustomPreview(Geometry=extr_2, Material=graft(gradient_2))  # disabled
swatch = ColourSwatch(SwatchColor=RGB(0, 0, 0))

# ---- group: Total Area
tag_5 = TextTag3D(Location=pt_2, Text=concat_2, Size="3", Colour=graft(swatch), Justification=5)

# ---- group: Areas
tag_6 = TextTag3D(Location=move_7.Geometry, Text=concat, Size=Slider(1.46, range=0..10), Colour=graft(swatch), Justification=5)

# ----
boundary_2 = BoundarySurfaces(Edges=flatten(rectangle_2.Rectangle))
number_slider_21 = Slider(0.3, range=0..1)  # disabled
button_3 = Button()  # disabled
bake = ObjectBake(
    BakeToggle=Button(),
    GeometryObjects=extr,
    Layer=item,
    ObjectName=stack,
    ObjectColor=graft(gradient),
    LayerColor=graft(gradient))
boundary_3 = BoundarySurfaces(Edges=flatten(rectangle_2.Rectangle))  # disabled
tstat_5 = TreeStatistics(Tree=geo)  # -> Paths, Length, Count; disabled
bake_2 = ObjectBake(
    BakeToggle=button_3,
    GeometryObjects=extr_2,
    Layer=item,
    ObjectName=stack,
    ObjectColor=RGB(255, 255, 255),
    LayerColor=graft(gradient_2))  # disabled
button_4 = Button()  # disabled
partition_3 = PartitionList(List=extr_3, Size=tstat_5.Length)  # disabled

move_8 = Move(Geometry=geo, Motion=Z)  # -> Geometry, Transform
wires = BrepWireframe(Brep=move_8.Geometry, Density=-1)
split = TextSplit(Text=stack, Separators=" ")
item_3 = ListItem(List=wires, Index=-1, Wrap=True)
lng_3 = ListLength(List=split)
addition = Addition(A=lng_3, B=1)
divide = DivideCurve(Curve=item_3, Count=addition, Kinks=False)  # -> Points, Tangents, Parameters
cull_ends_5 = CullEnds(List=divide.Points)  # -> List, Culled
lng_4 = ListLength(List=split)
dom_3 = ConstructDomain(DomainStart=Slider(0.23, range=0..1), DomainEnd=Slider(3.27, range=0..10))

area_3 = Area(Geometry=move_8.Geometry)  # -> Area, Centroid
ma_3 = MassAddition(Input=area_3.Area)  # -> flatten(Result), PartialResults
bnd = Bounds(Numbers=flatten(ma_3.Result))
dedomain = DeconstructDomain(Domain=flatten(bnd))  # -> Start, End

bnd_2 = Bounds(Numbers=flatten(area_3.Area))
remap = RemapNumbers(Value=area_3.Area, Source=bnd_2, Target=dom_3)  # -> Mapped, Clipped
stack_4 = StackData(Data=graft(remap.Mapped), Stack=lng_4)

gradient_3 = Gradient(
    LowerLimit=dedomain.End,
    UpperLimit=dedomain.Start,
    Parameter=flatten(ma_3.Result),
    stops=[0.0798: RGB(234, 38, 0), 0.244: RGB(234, 126, 0), 0.683: RGB(254, 244, 84), 0.877: RGB(173, 203, 249), 0.992: RGB(75, 107, 169)])

# ---- group: Bake
tag_7 = TextTag3D(
    Location=cull_ends_5.List,
    Text=split,
    Size=stack_4,
    Colour=ColourSwatch(SwatchColor=RGB(255, 255, 255)),
    Justification=4)

# ----
bake_3 = ObjectBake(
    BakeToggle=Button(),
    GeometryObjects=boundary_2,
    Layer="Total Areas",
    ObjectName="GH_Obj",
    ObjectColor=gradient_3,
    LayerColor=RGB(255, 255, 255))
previewmat = CustomPreviewMaterials(Geometry=boundary_2, DiffuseColor=gradient_3, Transparency=Slider(0.3, range=0..1))

move_9 = Move(Geometry=geo_2, Motion=Z_2)  # -> Geometry, Transform; disabled
wires_2 = BrepWireframe(Brep=move_9.Geometry, Density=-1)  # disabled
panel_3 = Panel(" ")  # disabled
split_2 = TextSplit(Text=stack, Separators=panel_3)  # disabled
item_4 = ListItem(List=wires_2, Index=-1, Wrap=True)  # disabled
lng_5 = ListLength(List=split_2)  # disabled
addition_2 = Addition(A=lng_5, B=1)  # disabled
divide_2 = DivideCurve(Curve=item_4, Count=addition_2, Kinks=False)  # -> Points, Tangents, Parameters; disabled
cull_ends_6 = CullEnds(List=divide_2.Points)  # -> List, Culled; disabled
number_slider_22 = Slider(0.23, range=0..1)  # disabled
number_slider_23 = Slider(3.27, range=0..10)  # disabled
lng_6 = ListLength(List=split_2)  # disabled
dom_4 = ConstructDomain(DomainStart=number_slider_22, DomainEnd=number_slider_23)  # disabled
swatch_2 = ColourSwatch(SwatchColor=RGB(255, 255, 255))  # disabled

area_4 = Area(Geometry=move_9.Geometry)  # -> Area, Centroid
ma_4 = MassAddition(Input=area_4.Area)  # -> flatten(Result), PartialResults; disabled
bnd_3 = Bounds(Numbers=flatten(ma_4.Result))  # disabled
dedomain_2 = DeconstructDomain(Domain=flatten(bnd_3))  # -> Start, End; disabled

bnd_4 = Bounds(Numbers=flatten(area_4.Area))  # disabled
remap_2 = RemapNumbers(Value=area_4.Area, Source=bnd_4, Target=dom_4)  # -> Mapped, Clipped; disabled
stack_5 = StackData(Data=graft(remap_2.Mapped), Stack=lng_6)  # disabled
tag_8 = TextTag3D(Location=cull_ends_6.List, Text=split_2, Size=stack_5, Colour=swatch_2, Justification=4)  # disabled

gradient_4 = Gradient(
    LowerLimit=dedomain_2.End,
    UpperLimit=dedomain_2.Start,
    Parameter=flatten(ma_4.Result),
    stops=[0.0798: RGB(234, 38, 0), 0.244: RGB(234, 126, 0), 0.683: RGB(254, 244, 84), 0.877: RGB(173, 203, 249), 0.992: RGB(75, 107, 169)])  # disabled
previewmat_2 = CustomPreviewMaterials(Geometry=boundary_3, DiffuseColor=gradient_4, Transparency=number_slider_21)  # disabled

move_10 = Move(Geometry=geo_3, Motion=Z_3)  # -> Geometry, Transform; disabled
wires_3 = BrepWireframe(Brep=move_10.Geometry, Density=-1)  # disabled
panel_4 = Panel(" ")  # disabled
split_3 = TextSplit(Text=stack, Separators=panel_4)  # disabled
item_5 = ListItem(List=wires_3, Index=-1, Wrap=True)  # disabled
lng_7 = ListLength(List=split_3)  # disabled
addition_3 = Addition(A=lng_7, B=1)  # disabled
divide_3 = DivideCurve(Curve=item_5, Count=addition_3, Kinks=False)  # -> Points, Tangents, Parameters; disabled
cull_ends_7 = CullEnds(List=divide_3.Points)  # -> List, Culled; disabled
number_slider_24 = Slider(0.23, range=0..1)  # disabled
number_slider_25 = Slider(3.27, range=0..10)  # disabled
lng_8 = ListLength(List=split_3)  # disabled
dom_5 = ConstructDomain(DomainStart=number_slider_24, DomainEnd=number_slider_25)  # disabled
swatch_3 = ColourSwatch(SwatchColor=RGB(255, 255, 255))  # disabled

area_5 = Area(Geometry=move_10.Geometry)  # -> Area, Centroid
bnd_5 = Bounds(Numbers=flatten(area_5.Area))  # disabled
dedomain_3 = DeconstructDomain(Domain=bnd_5)  # -> Start, End; disabled
gradient_5 = Gradient(
    LowerLimit=number_slider_20,
    UpperLimit=dedomain_3.Start,
    Parameter=area_5.Area,
    stops=[0: RGB(234, 38, 0), 0.313: RGB(234, 126, 0), 0.652: RGB(254, 244, 84), 0.876: RGB(173, 203, 249), 1: RGB(75, 107, 169)])  # disabled

bnd_6 = Bounds(Numbers=flatten(area_5.Area))  # disabled
remap_3 = RemapNumbers(Value=area_5.Area, Source=bnd_6, Target=dom_5)  # -> Mapped, Clipped; disabled
stack_6 = StackData(Data=graft(remap_3.Mapped), Stack=lng_8)  # disabled
tag_9 = TextTag3D(Location=cull_ends_7.List, Text=split_3, Size=stack_6, Colour=swatch_3, Justification=4)  # disabled

preview_3 = CustomPreview(Geometry=extr_3, Material=gradient_5)  # disabled
bake_4 = ObjectBake(
    BakeToggle=button_4,
    GeometryObjects=partition_3,
    Layer=item,
    ObjectName=stack,
    ObjectColor=RGB(255, 255, 255),
    LayerColor=graft(gradient_5))  # disabled

# ==== cluster Cluster
D = ClusterInput()
flip = FlipMatrix(Data=D)
tstat = TreeStatistics(Tree=flip)  # -> Paths, Length, Count
i = ClusterInput()
item = ListItem(List=tstat.Paths, Index=i, Wrap=True)
branch = TreeBranch(Tree=flip, Path=item, MaintainPaths=True)
B = ClusterOutput(branch)
