# Grasshopper definition volume_area_simplified.gh (Grasshopper 1.0.8)
# plug-ins: Pufferfish, UiPlus

label = UiLabel(Label="Site Area:")
# SITE AREA
panel = Panel("50000")
text_box = UiTextBox(Text=panel, Wrap=True)
text_box_2 = UiTextBox(Element=text_box, Text="Click here to change text", Wrap=True)
rh_sel_btn = UiRhinoSelectButton(Label="Select Massing", Filter=0)
graphics = UiSetGraphics(
    Element=rh_sel_btn,
    PrimaryColor=ColourSwatch(SwatchColor=RGB(79, 79, 79)),
    AccentColor=ColourSwatch(SwatchColor=RGB(255, 255, 255)),
    StrokeColor=ColourSwatch(SwatchColor=RGB(71, 71, 71)))
concat = Concatenate(FragmentA="GFZ:  ", FragmentB="0")
concat_2 = Concatenate(FragmentA="BGF:  ", FragmentB="0")
get_values = UiValues(Element=text_box_2)
text_block = UiTextBlock(Text=concat)
text_block_2 = UiTextBlock(Text=concat_2)
spacer = UiSpacer(Width=Slider(33, range=0..100), Horizontal=invert(False))
num = Number(get_values)
merge = Merge(Data1=rh_sel_btn, Data2=label, Data3=text_box, Data4=spacer, Data5=text_block_2, Data6=text_block)
font = UiSetFont(Element=rh_sel_btn, Size=Slider(12, range=0..100))
stack = UiStackLayout(Elements=merge, Horizontal=invert(True))

# ---- group: Turn on UI
# TURN ON UI
toggle = BooleanToggle(True)

# ----
font_2 = UiSetFont(Element=text_block, Size=Slider(20, range=0..100), Bold=Toggle(True))
font_3 = UiSetFont(Element=text_block_2, Size=Slider(20, range=0..100), Bold=Toggle(True))
window = UiWindow(Elements=stack, Title="Control Panel", Owner=2, Scroll=False, Launch=toggle)
modify_win = UiModifyWindow(Window=window, Position="100,200", HideControls=Toggle(True), HideTitle=Toggle(True))
get_values_2 = UiValues(Element=rh_sel_btn)

brep = Brep(get_values_2)
debrep = DeconstructBrep(Brep=brep)  # -> Faces, Edges, Vertices
lng = ListLength(List=debrep.Faces)
# CULLS SURFACES - POLYSURFACES ONLY
larger = LargerThan(FirstNumber=lng, SecondNumber=1)  # -> LargerThan, OrEqualTo
md_slider = MDSlider(SliderMode=0, slider_value=Point(0.5, 0.5, 0.5), x_domain=Domain(0, 1), y_domain=Domain(0, 1), z_domain=Domain(0, 1))
cull = CullPattern(List=debrep.Faces, CullPattern=larger.LargerThan)  # -> flatten(List)

evalsrf = EvaluateSurface(Surface=cull, Point=md_slider)  # -> Point, Normal, UDirection, VDirection, Frame

devec = DeconstructVector(Vector=evalsrf.Normal)  # -> XComponent, YComponent, ZComponent
equals = Equality(FirstNumber=devec.ZComponent, SecondNumber=-1)  # -> Equality, Inequality
dispatch = Dispatch(List=cull, DispatchPattern=equals.Equality)  # -> ListA, ListB
srf = Surface(dispatch.ListA)
area = Area(Geometry=srf)  # -> Area, Centroid

num_2 = Number(area.Area)

expression = Expression(x=num_2, Expression="round(x,2)")

# ----
# Floors
srf_2 = Surface(dispatch.ListA)

ma = MassAddition(Input=expression)  # -> Result, PartialResults
division = Division(A=ma.Result, B=num)
expression_2 = Expression(x=division, Expression="round(x,2)")
concat_3 = Concatenate(FragmentA="GFZ:  ", FragmentB=expression_2)
text_block_3 = UiTextBlock(Element=text_block, Text=concat_3)
roundf = RoundToFactor(NumberX=ma.Result, Factor=10, RoundType=0)  # -> Rounded, Difference, MultiplierR, MultiplierX
concat_4 = Concatenate(FragmentA="BGF:  ", FragmentB=roundf.Rounded, FragmentC="m2")
text_block_4 = UiTextBlock(Element=text_block_2, Text=concat_4)
concat_5 = Concatenate(FragmentA=ma.Result, FragmentB=" m2")
bruttogeschossfläche_m2 = Panel(concat_5)
# BGF
# GFZ
gfz = Panel(expression_2)
