# Grasshopper definition volume_areas.gh (Grasshopper 1.0.8)
# plug-ins: CORE.Toolbox.Grasshopper, Heteroptera, Pufferfish, Human, Parakeet, LunchBox, UiPlus, froGH

# ---- group: Site Areas
panel = Panel("Footprint area of existing buildings (in case of extension): ")
label = UiLabel(Label="Site Area:")
label_2 = UiLabel(Label=panel)
label_3 = UiLabel(Label="Roads and Parking Areas:")
text_box = UiTextBox(Text="50000", Wrap=True)
text_box_2 = UiTextBox(Text="50000", Wrap=True)
text_box_3 = UiTextBox(Text="50000", Wrap=True)
text_box_4 = UiTextBox(Element=text_box, Text="Click here to change text", Wrap=True)
text_box_5 = UiTextBox(Element=text_box_2, Text="Click here to change text", Wrap=True)
text_box_6 = UiTextBox(Element=text_box_3, Text="Click here to change text", Wrap=True)
get_values = UiValues(Element=text_box_4)
get_values_2 = UiValues(Element=text_box_5)
get_values_3 = UiValues(Element=text_box_6)
num = Number(get_values)
num_2 = Number(get_values_2)
num_3 = Number(get_values_3)
merge = Merge(Data2=label, Data3=text_box, Data4=label_3, Data5=text_box_3, Data6=label_2, Data7=text_box_2)
expander = UiExpanderLayout(Elements=merge, Title="Site Areas", Direction=0, Closed=True)

# ---- group: Start
rh_sel_btn = UiRhinoSelectButton(Label="Select Massing", Filter=0)
toggle = UiToggle(Label="Refresh Layers", State=invert(False))
graphics = UiSetGraphics(
    Element=rh_sel_btn,
    PrimaryColor=ColourSwatch(SwatchColor=RGB(79, 79, 79)),
    AccentColor=ColourSwatch(SwatchColor=RGB(255, 255, 255)),
    StrokeColor=ColourSwatch(SwatchColor=RGB(71, 71, 71)))
toggle_2 = UiToggle(Element=toggle, Label="Refresh Layers", State=invert(False))
font = UiSetFont(Element=rh_sel_btn, Size=Slider(12, range=0..100))
get_values_4 = UiValues(Element=toggle_2)
merge_2 = Merge(Data1=toggle, Data2=rh_sel_btn)
expander_2 = UiExpanderLayout(Elements=merge_2, Title="Start", Direction=0, Closed=True)

# ----
slider = UiSlider(Label="Stroke Width", Value=Slider(5, range=0..20), Bounds=Domain(0, 20), Increment=1)

panel_2 = Panel("\\berlin152\Office\03_Library\10 GH SCRIPTS\Tool Catalogue\AreaTools\Screenshots")
text_box_7 = UiTextBox(Text=panel_2, Wrap=True)
text_box_8 = UiTextBox(Element=text_box_7, Text=panel_2, Wrap=True)
toggle_3 = UiToggle(Label="Target Area View", State=False)
slider_2 = UiSlider(Label="Inner Circle Size", Value=Slider(115, range=0..1000), Bounds=Domain(20, 300), Increment=20)
slider_3 = UiSlider(Label="Outer Circle Size", Value=Slider(480, range=0..1000), Bounds=Domain(200, 800), Increment=20)
color_canvas_dropdown = UiColorCanvasDropdown(Color=ColourSwatch(SwatchColor=RGB(71, 71, 71)))
color_canvas_dropdown_2 = UiColorCanvasDropdown(Color=ColourSwatch(SwatchColor=RGB(255, 255, 255)))
slider_4 = UiSlider(Label="Area Percentage", Value=Slider(1, range=0..100), Bounds=Domain(0, 20), Increment=1)
slider_5 = UiSlider(Label="Round Up Numers by", Value=Slider(1, range=0..1), Bounds=Domain(0, 200), Increment=1)
button = UiButton(Label="Save Graph to:")
label_4 = UiLabel(Label=panel_2)
toggle_4 = UiToggle(Label="Short Names", State=False)
get_values_5 = UiValues(Element=button)
get_values_6 = UiValues(Element=text_box_7)
get_values_7 = UiValues(Element=slider_4)
get_values_8 = UiValues(Element=slider_5)
get_values_9 = UiValues(Element=toggle_3)
get_values_10 = UiValues(Element=color_canvas_dropdown)
get_values_11 = UiValues(Element=slider_2)
get_values_12 = UiValues(Element=slider_3)
get_values_13 = UiValues(Element=color_canvas_dropdown_2)
get_values_14 = UiValues(Element=toggle_4)
merge_3 = Merge(
    Data1=toggle_4,
    Data2=toggle_3,
    Data3=slider_2,
    Data4=slider_3,
    Data5=slider,
    Data6=slider_4,
    Data7=slider_5,
    Data8=color_canvas_dropdown,
    Data9=color_canvas_dropdown_2,
    Data10=button,
    Data11=text_box_7)

get_values_15 = UiValues(Element=slider)

# ---- group: Turn on UI
toggle_5 = BooleanToggle(True)

# ----
get_values_16 = UiValues(Element=rh_sel_btn)
clean = CleanTree(RemoveNulls=True, RemoveInvalid=True, RemoveEmpty=invert(False), Tree=get_values_16)
geo = Geometry(clean)

# ----
# Adding Road Area
# Total Footprint
number_slider = Slider(1, range=0..1)
center = Center(Geometric=geo, forall=True, referenceAll=2)  # -> Center, Dimension
Z = UnitZ(Factor=number_slider)
move = Move(Geometry=center.Center, Motion=Z)  # -> Geometry, Transform
sec = BrepPlane(Brep=geo, Plane=move.Geometry)  # -> Curves, Points
clean_2 = CleanTree(RemoveNulls=True, RemoveInvalid=True, RemoveEmpty=invert(False), Tree=sec.Curves)
Z_2 = UnitZ(Factor=Slider(30, range=0..100))
move_2 = Move(Geometry=clean_2, Motion=Z_2)  # -> Geometry, Transform
boundary = BoundarySurfaces(Edges=move_2.Geometry)
edges = BrepEdges(Brep=boundary)  # -> Naked, Interior, NonManifold
area = Area(Geometry=boundary)  # -> Area, Centroid
previewlw = CustomPreviewLineweights(Geometry=edges.Naked, Shader=ColourSwatch(SwatchColor=RGB(255, 255, 255)), Absolute=False)
ma = MassAddition(Input=flatten(area.Area))  # -> Result, PartialResults
custom_round = CustomRound(Numbers=ma.Result, Scope=get_values_8)
addition = Addition(A=ma.Result, B=num_3)
panel_3 = Panel(addition)

debrep = DeconstructBrep(Brep=geo)  # -> Faces, Edges, Vertices
center_2 = Center(Geometry=debrep.Faces)  # -> Center, Dimension
pdecon = Deconstruct(Point=center_2.Center)  # -> XComponent, YComponent, ZComponent
sort = SortList(Keys=pdecon.ZComponent, ValuesA=debrep.Faces)  # -> Keys, ValuesA
item = ListItem(List=sort.ValuesA, Index=-1, Wrap=True)
Z_3 = UnitZ(Factor=Slider(0.1, range=0..0.1))
move_3 = Move(Geometry=item, Motion=Z_3)  # -> Geometry, Transform
group = Group(Objects=flatten(move_3.Geometry))

center_3 = Center(Geometric=geo)  # -> Center, Dimension
scale = Scale(Geometry=geo, Center=center_3.Center, Factor="1.1")  # -> Geometry, Transform
edges_2 = BrepEdges(Brep=scale.Geometry)  # -> Naked, Interior, NonManifold
dash = DashPattern(Curve=edges_2.Interior, Pattern=Slider(1, range=0..10))  # -> Dashes, Gaps
swatch = ColourSwatch(SwatchColor=RGB(255, 255, 255))
line_prev = TTLineweightPreview(Geometry=dash.Dashes, Absolute_2=False)

division = Division(A=ma.Result, B=num)
custom_round_2 = CustomRound(Numbers=division, Scope=Slider(0.01, range=0..0.1))

# ----
# GRZ II
# Total sealed area
# Remaining Green Area
addition_2 = Addition(A=addition, B=num_2)
division_2 = Division(A=addition_2, B=num)
subtraction = Subtraction(A=1, B=division_2)
custom_round_3 = CustomRound(Numbers=division_2, Scope=Slider(0.01, range=0..0.1))
multiplication = Multiplication(A=subtraction, B=100)
round = Round(Number=multiplication)  # -> Nearest, Floor, Ceiling
toggle_6 = BooleanToggle(True)
swatch_2 = ColourSwatch(SwatchColor=RGB(91, 176, 51))
gauge_chart = UiGaugeChart(Circular=toggle_6)
dom = ConstructDomain(DomainStart="0", DomainEnd="100")
gauge_chart_2 = UiGaugeChart(
    Element=gauge_chart,
    Value=round.Nearest,
    Domain=dom,
    Circular=invert(toggle_6),
    InnerRadius=Slider(117, range=0..1000),
    LowColor=swatch_2,
    HighColor=swatch_2)
number_slider_2 = Slider(356, range=0..1000)
panel_4 = Panel("Akka Pro")
resize = UiResize(Element=gauge_chart_2, Width=number_slider_2, Height=number_slider_2)

data = Data(get_values_12)

concat = Concatenate(FragmentA="BGF:  ", FragmentB="0")
concat_2 = Concatenate(FragmentA="GFZ:  ", FragmentB="0")
text_block = UiTextBlock(Text="No text supplied")
text_block_2 = UiTextBlock(Text="No text supplied")
text_block_3 = UiTextBlock(Text="No text supplied")
concat_3 = Concatenate(FragmentA="GRZ:  ", FragmentB=custom_round_2)
concat_4 = Concatenate(FragmentA="GRZ II:  ", FragmentB=custom_round_3)
concat_5 = Concatenate(FragmentA="Building Footprint: ", FragmentB=custom_round)
text_block_4 = UiTextBlock(Text="No text supplied")
text_block_5 = UiTextBlock(Text="No text supplied")
text_block_6 = UiTextBlock(Element=text_block, Text=concat_3)
text_block_7 = UiTextBlock(Element=text_block_2, Text=concat_4)
text_block_8 = UiTextBlock(Element=text_block_3, Text=concat_5)
label_5 = UiLabel()
font_2 = UiSetFont(Element=text_block_4, Size=Slider(20, range=0..100), Bold=Toggle(True))
font_3 = UiSetFont(Element=text_block, Size=Slider(20, range=0..100), Bold=Toggle(True))
font_4 = UiSetFont(Element=text_block_2, Size=Slider(20, range=0..100), Bold=Toggle(True))
font_5 = UiSetFont(Element=text_block_3, Size=Slider(20, range=0..100), Bold=Toggle(True))
font_6 = UiSetFont(Element=text_block_5, Size=Slider(20, range=0..100), Bold=Toggle(True))
expander_3 = UiExpanderLayout(Elements=merge_3, Title="Area Graph Control", Direction=0, Closed=True)
graphics_2 = UiSetGraphics(
    Element=expander_3,
    PrimaryColor=ColourSwatch(SwatchColor=RGB(0, 0, 0)),
    AccentColor=ColourSwatch(SwatchColor=RGB(255, 255, 255)))

# ----
# TURN ON UI
panel_5 = Panel("Building Area Graph")
expander_4 = UiExpanderLayout(Elements=gauge_chart, Title="Green Area Graph", Direction=0, Closed=True)

freeze_gate = StreamFreezeGate(Data=clean, PassingSwitch=get_values_4)
f_olay = ObjectLayer(Object=freeze_gate)
split = TextSplit(Text=f_olay, Separators=":")
item_2 = ListItem(List=split, Index=Slider(2, range=0..10), Wrap=True)  # -> flatten(Item)
item_3 = ListItem(List=item_2, Index=0, Wrap=True)

item_4 = ListItem(List=split, Index="-1", Wrap=True)  # -> flatten(Item)
split_2 = TextSplit(Text=item_4, Separators=" ")
item_5 = ListItem(List=split_2, Index="-1", Wrap=True)  # -> flatten(Item)
cset = CreateSet(List=item_5)  # -> Set, Map

label_6 = UiLabel(Element=label_5, Label=item_3, Style=1)

debrep_2 = DeconstructBrep(Brep=geo)  # -> Faces, Edges, Vertices
# CULLS SURFACES - POLYSURFACES ONLY
lng = ListLength(List=debrep_2.Faces)
larger = LargerThan(FirstNumber=lng, SecondNumber=1)  # -> LargerThan, OrEqualTo
md_slider = MDSlider(SliderMode=0, slider_value=Point(0.5, 0.5, 0.5), x_domain=Domain(0, 1), y_domain=Domain(0, 1), z_domain=Domain(0, 1))
cull = CullPattern(List=debrep_2.Faces, CullPattern=larger.LargerThan)

evalsrf = EvaluateSurface(Surface=cull, Point=md_slider)  # -> Point, Normal, UDirection, VDirection, Frame

devec = DeconstructVector(Vector=evalsrf.Normal)  # -> XComponent, YComponent, ZComponent

roundd = RoundToDecimalPlace(NumberX=devec.ZComponent, DecimalPlace=Slider(1, range=0..1), RoundType=0)  # -> Rounded, Difference

equals = Equality(FirstNumber=roundd.Rounded, SecondNumber=-1)  # -> Equality, Inequality
dispatch = Dispatch(List=cull, DispatchPattern=equals.Equality)  # -> ListA, ListB
srf = Surface(flatten(dispatch.ListA))

# ----
# Floors
srf_2 = Surface(dispatch.ListA)

area_2 = Area(Geometry=srf)  # -> Area, Centroid

expression = Expression(x=area_2.Area, Expression="round(x,2)")

# ----
# BGF
# GFZ
ma_2 = MassAddition(Input=expression)  # -> Result, PartialResults
custom_round_4 = CustomRound(Numbers=ma_2.Result, Scope=get_values_8)
division_3 = Division(A=custom_round_4, B=num)
concat_6 = Concatenate(FragmentA=custom_round_4, FragmentB=" m2")
expression_2 = Expression(x=division_3, Expression="round(x,2)")
bruttogeschossfläche_m2 = Panel(concat_6)
gfz = Panel(expression_2)

concat_7 = Concatenate(FragmentA="BGF:  ", FragmentB=custom_round_4, FragmentC="m2")
text_block_9 = UiTextBlock(Element=text_block_4, Text=concat_7)
concat_8 = Concatenate(FragmentA="GFZ:  ", FragmentB=expression_2)
text_block_10 = UiTextBlock(Element=text_block_5, Text=concat_8)

id = Guid(clean)
get_attr = GetAttributes(GUID=id)
deattr = DeconstructAttributes(Attribute=get_attr)  # -> Name, Layer, Groups, Keys, Values
cset_2 = CreateSet(List=deattr.Layer)  # -> Set, Map
mindex = MemberIndex(Set=deattr.Layer, Member=cset_2.Set)  # -> Index, Count
item_6 = ListItem(List=deattr.Layer, Index=mindex.Index, Wrap=True)
item_7 = ListItem(List=item_6, Index=0, Wrap=True)
chars = Characters(Text=item_7)  # -> Result, Unicode
split_3 = TextSplit(Text=item_7, Separators=" ")
item_8 = ListItem(List=chars.Result, Index=0, Wrap=True)
item_9 = ListItem(List=split_3, Index=0, Wrap=True)

layer_info = LayerInformation(ReferenceToggle=get_values_4)  # -> Names, DisplayColors, GUID
mindex_2 = MemberIndex(Set=layer_info.Names, Member=deattr.Layer)  # -> Index, Count
item_10 = ListItem(List=mindex_2.Index, Index=0, Wrap=True)  # -> flatten(Item)
item_11 = ListItem(List=layer_info.DisplayColors, Index=item_10, Wrap=True)
item_12 = ListItem(List=item_11, Index=mindex.Index, Wrap=True)
item_13 = ListItem(List=item_12, Index=0, Wrap=True)  # -> flatten(Item)

lng_2 = ListLength(List=cset_2.Set)
filter = StreamFilter(Gate=get_values_14, Stream0=item_9, Stream1=item_8)

roundd_2 = RoundToDecimalPlace(NumberX=area_2.Area, DecimalPlace="0", RoundType=0)  # -> Rounded, Difference
item_14 = ListItem(List=roundd_2.Rounded, Index=mindex.Index, Wrap=True)
ma_3 = MassAddition(Input=item_14)  # -> flatten(Result), PartialResults
subtraction_2 = Subtraction(A=cset.Set, B=ma_3.Result)
custom_round_5 = CustomRound(Numbers=ma_3.Result, Scope=get_values_8)
abs = Absolute(Value=subtraction_2)
division_4 = Division(A=abs, B=custom_round_5)
pie = PieChart(custom_round_5)

larger_2 = LargerThan(FirstNumber=division_4, SecondNumber=Slider(0.99, range=0..1))  # -> LargerThan, OrEqualTo
dispatch_2 = Dispatch(List=division_4, DispatchPattern=larger_2.LargerThan)  # -> ListA, ListB
lng_3 = ListLength(List=division_4)
repeat = RepeatData(Data="-", Length=lng_3)
subtraction_3 = Subtraction(A=dispatch_2.ListA, B="1")

index = ItemIndex(List=division_4, Item=dispatch_2.ListA)
replace = ReplaceItems(List=division_4, Item=subtraction_3, Indices=index, Wrap=False)

replace_2 = ReplaceItems(List=repeat, Item="+", Indices=index, Wrap=False)

multiplication_2 = Multiplication(A=replace, B=100)
custom_round_6 = CustomRound(Numbers=multiplication_2, Scope="0.1")
gradient = Gradient(
    LowerLimit=get_values_7,
    UpperLimit=Slider(0, range=0..100),
    Parameter=custom_round_6,
    stops=[0: RGB(255, 0, 0), 0.00956: RGB(0, 255, 0)])

concat_9 = Concatenate(FragmentC=flatten(filter), FragmentD=" ", FragmentE=replace_2, FragmentA=custom_round_6, FragmentB="%")  # -> graft(Result)

filter_2 = StreamFilter(Gate=get_values_9, Stream0=filter, Stream1=concat_9)
concat_10 = Concatenate(FragmentA=filter_2, FragmentB=": ", FragmentC="(", FragmentD=graft(replace_2), FragmentE=graft(abs), FragmentF=")  ")
data_series = UIDataSeries(Label=concat_10, Data=graft(custom_round_5), Type=2)  # -> flatten(DataSeries)
ds_labels = UiDataSeriesLabels(DataSeries=graft(data_series), Color=simplify(get_values_10), Prefix=simplify(concat_10), Suffix=" m²")  # -> flatten(DataSet)
filter_3 = StreamFilter(Gate=get_values_9, Stream0=item_13, Stream1=gradient)
ds_graphics = UiDataSeriesGraphics(DataSeries=ds_labels, PrimaryColor=flatten(filter_3), AccentColor=get_values_13, Weight=get_values_15, Marker=0)
cell_graphics = UiCellGraphics(DataSeries=ds_graphics, StrokeWeights=Slider(0.5, range=0..1))
donut_chart = UiDonutChart(InnerRadius=50)
donut_chart_2 = UiDonutChart(Element=donut_chart, DataSeries=cell_graphics, InnerRadius=get_values_11)
resize_2 = UiResize(Element=donut_chart_2, Width=data, Height=data)

merge_4 = Merge(
    Data1=label_6,
    Data2=text_block_3,
    Data3=text_block_4,
    Data4=text_block,
    Data5=text_block_2,
    Data6=text_block_5,
    Data7=donut_chart,
    Data8=expander_3)

expander_5 = UiExpanderLayout(Elements=merge_4, Title=panel_5, Direction=0, Closed=True)
merge_5 = Merge(Data1=expander_2, Data2=expander, Data3=expander_5, Data4=expander_4)
stack = UiStackLayout(Elements=merge_5, Horizontal=invert(True))
window = UiWindow(Elements=stack, Title="Control Panel", Owner=2, Scroll=invert(False), Launch=toggle_5)
graphics_3 = UiSetGraphics(
    Element=merge_5,
    PrimaryColor=ColourSwatch(SwatchColor=RGB(0, 0, 0)),
    AccentColor=ColourSwatch(SwatchColor=RGB(255, 255, 255)))
modify_win = UiModifyWindow(Window=window, Position="100,200", HideControls=Toggle(True), HideTitle=Toggle(True))

capture = UiCaptureImage(Window=window, FolderPath=get_values_6, FileName=item_3, Resolution="96", Save=get_values_5)
